# Grasshopper definition racetrack.gh (Grasshopper 1.0.7)

curve = Curve(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)
unit_z = UnitZ(Factor=Slider(10, range=0..10))
move = Move(Geometry=curve, Motion=unit_z)  # -> Geometry, Transform
control_points = ControlPoints(Curve=move.Geometry)  # -> Points, Weights, Knots
list_length = ListLength(List=control_points.Points)
subtraction = Subtraction(A=list_length, B=Slider(2, range=0..10))
sub_list = SubList(List=control_points.Points, Domain=subtraction, Wrap=True)  # -> List, Index
nurbs_curve = NurbsCurve(Vertices=sub_list.List, Degree=3, Periodic=True)  # -> Curve, Length, Domain

perp_frames = PerpFrames(Curve=nurbs_curve.Curve, Count=Slider(534, range=0..1000), Align=True)  # -> Frames, Parameters
curvature = Curvature(Curve=nurbs_curve.Curve, Parameter=perp_frames.Parameters)  # -> Point, Curvature, Curvature_2
construct_domain = ConstructDomain(DomainStart=Slider(6, range=0..10), DomainEnd=Slider(12, range=0..100))
bounds = Bounds(Numbers=curvature.Curvature)
remap_numbers = RemapNumbers(Value=curvature.Curvature, Source=bounds, Target=construct_domain)  # -> Mapped, Clipped
negative = Negative(Value=remap_numbers.Mapped)
construct_domain_2 = ConstructDomain(DomainStart=negative, DomainEnd=remap_numbers.Mapped)
rectangle = Rectangle(Plane=perp_frames.Frames, XSize=construct_domain_2, YSize=Domain(1.5, 2), Radius=0)  # -> Rectangle, Length
loft_options = LoftOptions(Closed=True, Adjust=False, Rebuild=0, Refit=0, Type=0)
loft = Loft(Curves=rectangle.Rectangle, Options=loft_options)

# ---- group: Columns
divide_curve = DivideCurve(Curve=nurbs_curve.Curve, Count=Slider(73, range=0..100), Kinks=False)  # -> Points, Tangents, Parameters
deconstruct_vector = DeconstructVector(Vector=divide_curve.Points)  # -> XComponent, YComponent, ZComponent
vector_xyz = VectorXYZ(XComponent=deconstruct_vector.XComponent, YComponent=deconstruct_vector.YComponent, ZComponent=0)  # -> Vector, Length
cylinder = Cylinder(Base=vector_xyz.Vector, Radius=Slider(1, range=0..1), Length=deconstruct_vector.ZComponent)

# ---- group: railings
number_slider = Slider(2, range=0..10)
number_slider_2 = Slider(0.1, range=0..0.1)
number_slider_3 = Slider(1, range=0..1)
vector_xyz_2 = VectorXYZ(XComponent=remap_numbers.Mapped, YComponent=number_slider, ZComponent=0)  # -> Vector, Length
vector_xyz_3 = VectorXYZ(XComponent=negative, YComponent=number_slider, ZComponent=0)  # -> Vector, Length
rectangle_2 = Rectangle(Plane=vector_xyz_2.Vector, XSize=number_slider_2, YSize=number_slider_3, Radius=0)  # -> Rectangle, Length
rectangle_3 = Rectangle(Plane=vector_xyz_3.Vector, XSize=number_slider_2, YSize=number_slider_3, Radius=0)  # -> Rectangle, Length
orient = Orient(Geometry=rectangle_2.Rectangle, Source=PlaneXY(0, 0, 0), Target=perp_frames.Frames)  # -> Geometry, Transform
orient_2 = Orient(Geometry=rectangle_3.Rectangle, Source=PlaneXY(0, 0, 0), Target=perp_frames.Frames)  # -> Geometry, Transform
loft_2 = Loft(Curves=orient.Geometry, Options=loft_options)
loft_3 = Loft(Curves=orient_2.Geometry, Options=loft_options)

# ---- group: roadbeam
rectangle_4 = Rectangle(Plane=perp_frames.Frames, XSize=Domain(-4, 4), YSize=Domain(-0.5, 1.5), Radius=0)  # -> Rectangle, Length
loft_4 = Loft(Curves=rectangle_4.Rectangle, Options=loft_options)

# ----
custom_preview = CustomPreview(Geometry=cylinder, Material=ColourSwatch(SwatchColor=RGB(255, 254, 254)))
custom_preview_2 = CustomPreview(
    Geometry=loft_4,
    Material={diffuse=RGB(228, 178, 227), emission=RGB(68, 53, 68), shine=0.5, specular=RGB(255, 254, 254), transparency=0})
custom_preview_3 = CustomPreview(Geometry=loft, Material=ColourSwatch(SwatchColor=RGB(129, 130, 128)))
custom_preview_4 = CustomPreview(Geometry=[loft_2, loft_3], Material=ColourSwatch(SwatchColor=RGB(255, 254, 0)))

# ---- group: lights
perp_frames_2 = PerpFrames(Curve=nurbs_curve.Curve, Count=Slider(144, range=0..1000), Align=True)  # -> Frames, Parameters
curvature_2 = Curvature(Curve=nurbs_curve.Curve, Parameter=perp_frames_2.Parameters)  # -> Point, Curvature, Curvature_2
number_slider_4 = Slider(9, range=0..10)
number_slider_5 = Slider(0, range=0..100)
remap_numbers_2 = RemapNumbers(Value=curvature_2.Curvature, Source=bounds, Target=construct_domain)  # -> Mapped, Clipped
vector_xyz_4 = VectorXYZ(XComponent=Slider(4, range=0..10), YComponent=Slider(11, range=0..100), ZComponent=0)  # -> Vector, Length
vector_xyz_5 = VectorXYZ(XComponent=number_slider_5, YComponent=0, ZComponent=0)  # -> Vector, Length
vector_xyz_6 = VectorXYZ(XComponent=number_slider_5, YComponent=Slider(8, range=0..10), ZComponent=0)  # -> Vector, Length
number_slider_6 = Slider(0.25, range=0..1)
xz_plane = XZPlane(Origin=Point(0, 0, 0))
negative_2 = Negative(Value=remap_numbers_2.Mapped)
polyline = PolyLine(Vertices=[vector_xyz_5.Vector, vector_xyz_6.Vector, vector_xyz_4.Vector], Closed=False)
rectangle_5 = Rectangle(Plane=xz_plane, XSize=number_slider_6, YSize=number_slider_6, Radius=0)  # -> Rectangle, Length
sweep1 = Sweep1(Rail=polyline, Sections=rectangle_5.Rectangle, Miter=1)
xy_plane = XYPlane(Origin=Point(0, 0, 0))
cap_holes = CapHoles(Brep=sweep1)

# ----
vector_xyz_7 = VectorXYZ(XComponent=negative_2, YComponent=Slider(1.5, range=0..10), ZComponent=0)  # -> Vector, Length

# ---- group: lights (continued)
move_2 = Move(Geometry=cap_holes, Motion=vector_xyz_7.Vector)  # -> Geometry, Transform
orient_3 = Orient(Geometry=move_2.Geometry, Source=xy_plane, Target=perp_frames_2.Frames)  # -> Geometry, Transform

# ----
custom_preview_5 = CustomPreview(Geometry=orient_3.Geometry, Material=ColourSwatch(SwatchColor=RGB(0, 254, 254)))
